# Grasshopper definition XHG.⠀⠀⠀⠀ⵙ⠀ᗱᗴ⠀ⵙ⠀ᴥ⠀ⵙ⠀ᗱᗴ⠀ⵙ⠀옷⠀ⵙ⠀ߦ⠀ⵙ⠀ᔓᔕ⠀ⵙ⠀⠀◯⠀⠀ⵙ⠀ИN⠀ⵙ⠀Ⓞ⠀ⵙ⠀⠀◯⠀⠀ⵙ⠀ИN⠀ⵙ⠀Ⓞ⠀ⵙ⠀ꖴ⠀ⵙ⠀✤⠀ⵙ⠀ᑐᑕ⠀ⵙ⠀ᗱᗴ⠀ⵙ⠀ᒍᒐ⠀ⵙ⠀Ⓞ⠀ⵙ⠀ᴥ⠀ⵙ⠀ߦ⠀ⵙ⠀⠀⠀⠀◯⠀⠀⠀⠀ⵙ⠀⠀⠀⠀◯⠀⠀⠀⠀ⵙ⠀ߦ⠀ⵙ⠀ᴥ⠀ⵙ⠀Ⓞ⠀ⵙ⠀ᒍᒐ⠀ⵙ⠀ᗱᗴ⠀ⵙ⠀ᑐᑕ⠀ⵙ⠀✤⠀ⵙ⠀ꖴ⠀ⵙ⠀Ⓞ⠀ⵙ⠀ИN⠀ⵙ⠀⠀◯⠀⠀ⵙ⠀Ⓞ⠀ⵙ⠀ИN⠀ⵙ⠀⠀◯⠀⠀ⵙ⠀ᔓᔕ⠀ⵙ⠀ߦ⠀ⵙ⠀옷⠀ⵙ⠀ᗱᗴ⠀ⵙ⠀ᴥ⠀ⵙ⠀ᗱᗴ⠀ⵙ⠀⠀⠀⠀.GHX (Grasshopper 1.0.7)
# plug-ins: Heteroptera, Pufferfish

digit_scroller = DigitScroller(Scroller_Digits=12, Scroller_Prefix=" ", Scroller_Radix=11, Scroller_Value=16)
range = Range(Domain=Domain(1e-07, 1), Steps=digit_scroller)  # -> reverse(Range)

digit_scroller_2 = DigitScroller(Scroller_Digits=12, Scroller_Prefix=" ", Scroller_Radix=1, Scroller_Value=0.538)
expression = Expression(X=range, O=Slider(2.4, range=0..4), Expression="1-(1-ABS(X-0)^O)^(((1)/(O)))")
expression_2 = Expression(X=range, O=Slider(1.952955, range=0..4), Expression="(1-ABS(X-1)^O)^(((1)/(O)))")

plane_surface = PlaneSurface(Plane=PlaneXY(0, 0, 1), XSize=Domain(-1, 1), YSize=Domain(-1, 1))
center = Center(Geometric=plane_surface, forall=True, referenceAll=0)  # -> Center, Dimension
graph_mapper = GraphMapper(range, x0=0, x1=1, y0=0, y1=1, Cx=0.7272727489, Cy=0.25, container_name="Conic")
rectangle = Rectangle(plane_surface)
quick_graph = QuickGraph(expression_2, SortOrder=0)
range_2 = Range(Domain=Domain(1e-28, 1), Steps=digit_scroller)
expression_3 = Expression(X=range_2, O=Slider(1.6, range=0..4), Expression="(1-ABS(X-1)^O)^(((1)/(O)))")
quad_sphere = QuadSphere(Base=PlaneXY(0, 0, 0), Radius=1)
deconstruct_brep = DeconstructBrep(Brep=quad_sphere)  # -> Faces, Edges, Vertices

expression_4 = Expression(X=range_2, O=Slider(2.4, range=0..4), Expression="1-(1-ABS(X-0)^O)^(((1)/(O)))")
expression_5 = Expression(X=range_2, O=Slider(0.1, range=0..4), Expression="(1-ABS(X-1)^O)^(((1)/(O)))")

arc = Arc(Plane=PlaneXY(1, 0.5, 0), Radius=0.5, Angle=Domain(1.570796327, 3.141592654))  # -> Arc, Length
arc_2 = Arc(Plane=Plane(origin=(0, 0.5, 0), x=(-1, 0, 0), y=(0, -1, 0)), Radius=0.5, Angle=Domain(1.570796327, 3.141592654))  # -> Arc, Length
list_item = ListItem(List=deconstruct_brep.Faces, Index=0, Wrap=False)

digit_scroller_3 = DigitScroller(Scroller_Digits=12, Scroller_Prefix=" ", Scroller_Radix=1, Scroller_Value=0.538)
expression_6 = Expression(X=range, O=Slider(2, range=0..4), Expression="(1-ABS(X-1)^O)^(((1)/(O)))")

expression_7 = Expression(X=range_2, Expression="-cos(((x*PI)))/2+.5")
point = Point(Point(0, 0, 0))
join_curves = JoinCurves(Curves=[arc_2.Arc, arc.Arc], Preserve=False)
expression_8 = Expression(X=range, Expression="-cos(((x*PI)))/2+.5")
graph_mapper_2 = GraphMapper(range_2, x0=0, x1=1, y0=0, y1=1, container_name="Sigmoid-Logits", e=0.04574238136, t0=-100, t1=100)
expression_9 = Expression(X=range, Expression="asin(((x-.5)*2))/PI+.5")
line_sdl = LineSDL(Start=Point(0, 0, 0), Direction=Vector(1, 1, 0), Length=1.414213562)
mirror = Mirror(Geometry=join_curves, Plane=Plane(origin=(0, 0, 0), x=(0, 0, 1), y=(0.7071067812, 0.7071067812, 0)))  # -> Geometry, Transform
expression_10 = Expression(X=range_2, Expression="asin(((x-.5)*2))/PI+.5")
construct_point = ConstructPoint(XCoordinate=range, YCoordinate=expression_6, ZCoordinate=0)
construct_point_2 = ConstructPoint(XCoordinate=range, YCoordinate=expression_8, ZCoordinate=0)
graph_mapper_3 = GraphMapper(range_2, x0=0, x1=1, y0=0, y1=1, Cx=0.2934313715, Cy=0.7839678526, container_name="Conic")
digit_scroller_4 = DigitScroller(Scroller_Digits=12, Scroller_Prefix="Digit Scroller", Scroller_Radix=9, Scroller_Value=16)
interpolate = Interpolate(Vertices=construct_point_2, Degree=3, Periodic=False, KnotStyle=1)  # -> Curve, Length, Domain
number_slider = Slider(0.666666, range=0..2)
number = Number(digit_scroller)
scale = Scale(Geometry=construct_point, Center=Point(0, 0, 0), Factor=0.5)  # -> reverse(Geometry), Transform
mirror_2 = Mirror(Geometry=scale.Geometry, Plane=Plane(origin=(0, 0, 0), x=(0, 0, 1), y=(0.7071067812, 0.7071067812, 0)))  # -> Geometry, Transform
move = Move(Geometry=mirror_2.Geometry, Motion=Vector(0.5, 0.5, 0))  # -> Geometry, Transform
digit_scroller_5 = DigitScroller(Scroller_Digits=12, Scroller_Prefix="Digit Scroller", Scroller_Radix=11, Scroller_Value=83)
scale_2 = Scale(Geometry=scale.Geometry, Center=Point(0, 0, 0), Factor=number_slider)  # -> Geometry, Transform
scale_3 = Scale(Geometry=move.Geometry, Center=Point(0, 0, 0), Factor=expr("2-X", number_slider))  # -> Geometry, Transform
digit_scroller_6 = DigitScroller(Scroller_Digits=12, Scroller_Prefix="Digit Scroller", Scroller_Radix=11, Scroller_Value=13)
list_item_2 = ListItem(List=reverse(scale_2.Geometry), Index=0, Wrap=False)
list_item_3 = ListItem(List=scale_3.Geometry, Index=0, Wrap=False)
dot_display = DotDisplay(Point=list_item_2, Colour=RGB(0, 0, 0), Size=0.0625)  # disabled
vector_2pt = Vector2Pt(PointA=list_item_3, PointB=list_item_2, Unitize=False)  # -> Vector, Length
move_2 = Move(Geometry=scale_3.Geometry, Motion=vector_2pt.Vector)  # -> Geometry, Transform
merge = Merge(Data1=scale_2.Geometry, Data2=move_2.Geometry)
cull_duplicates = CullDuplicates(Points=merge, Tolerance=0.00390625, CullMode=1)  # -> Points, Indices, Valence
interpolate_2 = Interpolate(Vertices=cull_duplicates.Points, Degree=3, Periodic=False, KnotStyle=1)  # -> Curve, Length, Domain
scale_4 = Scale(Geometry=interpolate_2.Curve, Center=Point(0, 0, 0), Factor=expr("2^X", digit_scroller_4))  # -> Geometry, Transform
end_points = EndPoints(Curve=scale_4.Geometry)  # -> Start, End
rectangle_2pt = Rectangle2Pt(Plane=PlaneXY(0, 0, 0), PointA=end_points.Start, PointB=end_points.End, Radius=0)  # -> Rectangle, Length
graphmapper = GraphMapper(Curve=scale_4.Geometry, Boundary=rectangle_2pt.Rectangle, Numbers=range_2, bobo=True)
curve_graph_mapper = CurveGraphMapper(Curves=scale_4.Geometry, Rectangle=rectangle_2pt.Rectangle, Values=range, Flip=False, Snap=True, TextSize=1)  # -> Mapped, GraphCurves, GraphPoints, ValueLines, ValuePoints, MappedLines, MappedPoints, Boundary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; disabled
graphmapper_2 = GraphMapper(Curve=scale_4.Geometry, Boundary=rectangle_2pt.Rectangle, Numbers=range, bobo=False)
scale_5 = Scale(Geometry=rectangle, Center=center.Center, Factor=graphmapper_2)  # -> graft(Geometry), Transform
divide_curve = DivideCurve(Curve=scale_5.Geometry, Count=expr("X*4", digit_scroller), Kinks=False)  # -> Points, Tangents, Parameters
flip_matrix = FlipMatrix(Data=divide_curve.Points)
pull_point = PullPoint(Point=flip_matrix, Geometry=list_item, ClosestOnly=False)  # -> ClosestPoint, Distance; disabled
extrude_point = ExtrudePoint(Base=scale_5.Geometry, Point=point)  # disabled
interpolate_3 = Interpolate(Vertices=flip_matrix, Degree=3, Periodic=False, KnotStyle=1)  # -> Curve, Length, Domain
extrude_point_2 = ExtrudePoint(Base=interpolate_3.Curve, Point=point)  # disabled
prude_curve = PrudeCurve(Curve=scale_5.Geometry, Length=graft(graphmapper), BlendType=1, Bulge=0.5)  # -> Prude, ResultBoolean
pull_curve = PullCurve(Curve=interpolate_3.Curve, Surface=list_item)
flip_matrix_2 = FlipMatrix(Data=divide_curve.Points)
brep_brep = BrepBrep(BrepA=extrude_point, BrepB=list_item)  # -> Curves, Points
prude_curve_2 = PrudeCurve(Curve=scale_5.Geometry, Length=graft(graphmapper), BlendType=0, Bulge=Slider(0.4, range=0..1))  # -> Prude, ResultBoolean
pull_curve_2 = PullCurve(Curve=prude_curve_2.Prude, Surface=list_item)
brep_brep_2 = BrepBrep(BrepA=extrude_point_2, BrepB=list_item)  # -> Curves, Points
curve = Curve(pull_curve)
curve_2 = Curve(pull_curve_2)
curve_curve = CurveCurve(CurveA=flatten(curve), CurveB=curve_2)  # -> Points, ParamsA, ParamsB; disabled
curvature_graph = CurvatureGraph(Curve=pull_curve_2, Density=1, Scale=digit_scroller_5)  # disabled
merge_2 = Merge(Data1=curve, Data2=curve_2)
mirror_3 = Mirror(Geometry=merge_2, Plane=PlaneXY(0, 0, 0))  # -> Geometry, Transform
merge_3 = Merge(Data1=merge_2, Data2=mirror_3.Geometry)
polar_array = PolarArray(
    Geometry=graft(merge_3),
    Plane=[Plane(origin=(0, 0, 0), x=(0, 0, 1), y=(1, 0, 0)), PlaneYZ(0, 0, 0)],
    Count=2,
    Angle=3.141592654)  # -> Geometry, Transform
geometry = Geometry(polar_array.Geometry)
